# Grasshopper definition FiveFoldSantaCake.gh (Grasshopper 1.0.7)
# plug-ins: MeshEdit Components, Human

phase = Slider(0, range=0..6.3)
number_slider = Slider(5, range=0..12)
amp = Slider(1, range=-2..2)
amp_2 = Slider(0.12, range=-2..2)
number_slider_2 = Slider(0, range=0..12)
amp_3 = Slider(0.793, range=-2..2)
amp_4 = Slider(-2, range=-2..2)
R = Slider(5.933, range=0..10)
number_slider_3 = Slider(5, range=0..12)
amp_5 = Slider(-1.826, range=-2..2)
amp_6 = Slider(-0.678, range=-2..2)
phase_2 = Slider(0, range=0..6.3)
phase_3 = Slider(1.955, range=0..6.3)
_0 = DomainStart(1e-10)
number_slider_4 = Slider(89, range=0..100)
int = Integer(number_slider_4)
domx = ConstructDomain(DomainStart=_0, DomainEnd=1)
domy = ConstructDomain(DomainStart=_0, DomainEnd=1)
rangex = Range(Domain=domx, Steps=int)
rangey = Range(Domain=domy, Steps=number_slider_4)
computebessel3rd = GhPythonScript(r=rangey, n=number_slider_3, m=Slider(7, range=0..12))  # -> out, a
# ---------- computebessel3rd: Python ----------
"""Provides a scripting component.
    Inputs:
        r: the radial variable
        n: The order of the Bessel function
        m: The number of the zero by which we scale
    Output:
        a: The value of the Bessel function J_n(\lambda_{n,m}r)"""

__author__ = "Paisley"
__version__ = "2023.08.05"

import rhinoscriptsyntax as rs
import mpmath as mp

mp.dps = 25; mp.pretty = True
z=mp.besseljzero(n,m)
ra=z*r
a=mp.besselj(n,ra)
print a
# ---------- end computebessel3rd ----------
computebessel2nd = GhPythonScript(r=rangey, n=number_slider, m=Slider(7, range=0..12))  # -> out, a; same code as computebessel3rd
computebessel = GhPythonScript(r=rangey, n=number_slider_2, m=Slider(1, range=0..12))  # -> out, a; same code as computebessel3rd
computewave = Evaluate(
    F="S*J*(a*cos(2*pi*n*(t+phi))+b*sin(2*pi*n*(t+phi)))",
    J=computebessel.out,
    n=number_slider_2,
    a=amp,
    b=amp_2,
    phi=phase,
    t=graft(rangex),
    S=R)
computewave2nd = Evaluate(
    F="S*J*(a*cos(2*pi*n*(t+phi))+b*sin(2*pi*n*(t+phi)))",
    J=computebessel2nd.out,
    n=number_slider,
    a=amp_4,
    b=amp_3,
    phi=phase_2,
    t=rangex,
    S=R)
computewave3rd = Evaluate(
    F="S*J*(a*cos(2*pi*n*(t+phi))+b*sin(2*pi*n*(t+phi)))",
    J=computebessel3rd.out,
    n=number_slider_3,
    a=amp_6,
    b=amp_5,
    phi=phase_3,
    t=rangex,
    S=R)
expression = Expression(x=rangex, y=graft(rangey), R=R, Expression="R*sin(2*Pi*x)*y")
expression_2 = Expression(x=rangex, y=graft(rangey), R=R, Expression="R*cos(2*Pi*x)*y")
addthree = Evaluate(F="x+y+z", x=computewave, y=computewave2nd, z=computewave3rd)
expression_3 = Expression(x=rangex, y=graft(rangey), R=addthree, Expression="R")
panel = Panel(computebessel2nd.out)
pt = ConstructPoint(XCoordinate=expression_2, YCoordinate=expression, ZCoordinate=expression_3)
pt_2 = ConstructPoint(XCoordinate=rangex, YCoordinate=reverse(graft(rangey)), ZCoordinate=0)  # -> flatten(Point)
expression_4 = Expression(x=int, Expression="x+1")
pshift = ShiftPaths(Data=pt, Offset=-1)
frompoints = MeshFromPoints(Points=pshift, UDirection=expression_4, VDirection=expression_4)
custom_map = CustomMapping(Mesh=frompoints, UVTextureCoordinates=pt_2)
path = FilePath("C:\Users\Paisley\OneDrive\桌面\summer-research-2023\matlab\BesselFunction\ArtisticImages\StrawberryCake\StrawberryCakeCMap.jpg")
materials = CreateModifyMaterials(Name="Name", Gloss=0.6, DiffuseBitmap=path)
previewmat = CustomPreviewMaterials(Geometry=custom_map, DiffuseColor=RGB(255, 255, 255), DiffuseBitmap=path)
createatts = CreateAttributes(MaterialName=materials, Visibility=True, enableFullPath=False)
bake = BakeGeometry(Bake=Button(), Geometry=custom_map, Attributes=createatts, DeleteOldBakes=False, PreserveTrees=False)
